# Grasshopper definition test.gh (Grasshopper 0.9.76)
# plug-ins: MeshEdit Components, Circulation

geo = Geometry(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)
pt = Point(Point(4.061976839, 3.453296541, 0))
geo_2 = Geometry([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])
pt_2 = Point(Point(-10.4217009, -4.99737389, 0))
node = Node(Position=pt, Name="start", Floor="floor1")
node_2 = Node(Position=pt_2, Name="end", Floor="floor1")
floor = Floor(Boundary=geo, Name="floor1")
agent = Agent(Name="agent1", Origin="start", Destination="end")
barrier = Barrier(Boundary=geo_2, Floor="floor1")
number_slider = Slider(0.5, range=0..1)
environment = Environment(Entities=[floor, node, node_2, barrier, agent], Resolution=Slider(1, range=0..10))  # -> Info, Floors, AgentPaths, BarrierMap

facen = FaceNormals(Mesh=environment.Floors)  # -> Centers, Normals
lng = ListLength(List=facen.Centers)
series = Series(Start=0, Step=1, Count=lng)
int = Integer(series)
tag = TextTag3D(Location=facen.Centers, Text=int, Size=Slider(0.25, range=0..1), Justification=7)

panel = Panel(environment.BarrierMap)
gradient = Gradient(LowerLimit=0, UpperLimit=1, Parameter=environment.BarrierMap, stops=[0: RGB(0, 0, 0), 1: RGB(255, 255, 255)])
explode = MeshExplode(Mesh=environment.Floors, Interpolate=False)
item = ListItem(List=facen.Centers, Index=environment.AgentPaths, Wrap=True)
pline = PolyLine(Vertices=item, Closed=False)
preview = CustomPreview(Geometry=explode, Shader=gradient)
